# Grasshopper definition team_05_working.gh (Grasshopper 1.0.8)
# plug-ins: Swiftlet

# ----
# Connect MCP Tools to Decall and Update All Clusters
button = Button()
# IF SOMETHING IS NOT
# WORKING PRESS THIS
# BUTTON FIRST
toggle = BooleanToggle(True)
connect_mcp_tools_to_decall = CSharpScript(nickname_From="Central MCP Server", nickname_To="Central DeCall", connect=button)  # -> out; inputs nickname_From: String, nickname_To: String, connect: Boolean
# ---------- connect_mcp_tools_to_decall: C# ----------
using System;
using System.Linq;
using Grasshopper;
using Grasshopper.Kernel;

public class Script_Instance : GH_ScriptInstance
{
    private void RunScript(string nickname_From, string nickname_To, bool connect)
    {
        if (!connect) return;
        Console.Write($"Attempting to connect outputs from '{nickname_From}' to '{nickname_To}'...");

        var ghDoc = Instances.ActiveCanvas?.Document;
        if (ghDoc == null) return;

        var compFrom = ghDoc.Objects
            .OfType<IGH_Component>()
            .FirstOrDefault(o => o.NickName == nickname_From);

        var compTo = ghDoc.Objects
            .OfType<IGH_Param>()
            .FirstOrDefault(o => o.NickName == nickname_To);

        if (compFrom != null && compTo != null)
        {
            ghDoc.ScheduleSolution(5, doc => Connect(doc, compFrom, compTo));
        }
    }

    // <Custom additional code> 
    private void Connect(GH_Document doc, IGH_Component compFrom, IGH_Param compTo)
    {
        if (compFrom == null || compTo == null) return;

        foreach (IGH_Param param in compFrom.Params.Output)
        {
            compTo.AddSource(param);
        }
    }
}
# ---------- end connect_mcp_tools_to_decall ----------
update_all_clusters = CSharpScript(update=button, recursive=toggle)  # -> out, A; inputs update: Boolean, recursive: Boolean, passwords: list of String, localPath: String
# ---------- update_all_clusters: C# ----------
using System;
using System.Collections;
using System.Collections.Generic;

using Rhino;
using Rhino.Geometry;

using Grasshopper;
using Grasshopper.Kernel;
using Grasshopper.Kernel.Data;
using Grasshopper.Kernel.Types;
using System.Windows.Forms;
using System.Linq;
/// <summary>
/// This class will be instantiated on demand by the Script component.
/// </summary>
public class Script_Instance : GH_ScriptInstance
{
  /// <summary>Print a String to the [Out] Parameter of the Script component.</summary>
  /// <param name="text">String to print.</param>
  private void Print(string text) { /* Implementation hidden. */ }
  /// <summary>Print a formatted String to the [Out] Parameter of the Script component.</summary>
  /// <param name="format">String format.</param>
  /// <param name="args">Formatting parameters.</param>
  private void Print(string format, params object[] args) { /* Implementation hidden. */ }
  /// <summary>Print useful information about an object instance to the [Out] Parameter of the Script component. </summary>
  /// <param name="obj">Object instance to parse.</param>
  private void Reflect(object obj) { /* Implementation hidden. */ }
  /// <summary>Print the signatures of all the overloads of a specific method to the [Out] Parameter of the Script component. </summary>
  /// <param name="obj">Object instance to parse.</param>
  private void Reflect(object obj, string method_name) { /* Implementation hidden. */ }

  /// <summary>Gets the current Rhino document.</summary>
  private readonly RhinoDoc RhinoDocument;
  /// <summary>Gets the Grasshopper document that owns this script.</summary>
  private readonly GH_Document GrasshopperDocument;
  /// <summary>Gets the Grasshopper script component that owns this script.</summary>
  private readonly IGH_Component Component;
  /// <summary>
  /// Gets the current iteration count. The first call to RunScript() is associated with Iteration==0.
  /// Any subsequent call within the same solution will increment the Iteration count.
  /// </summary>
  private readonly int Iteration;

  /// <summary>
  /// This procedure contains the user code. Input parameters are provided as regular arguments,
  /// Output parameters as ref arguments. You don't have to assign output parameters,
  /// they will have a default value.
  /// </summary>
  private void RunScript(
		bool update,
		bool recursive,
		List<string> passwords,
		string localPath,
		ref object A)
  {

    A = updateLog;
    if (update)
    {
      updateLog = new List<string>();
      _passwords = passwords;
      UpdateClusters(GrasshopperDocument, recursive, localPath);
    }

  }

  // <Custom additional code> 
  List<string> updateLog;
  List<String> _passwords;

  void UpdateClusters (GH_Document ghDoc, bool recursive, string localPath)
  {
    foreach (var obj in ghDoc.Objects)
    {
      var cluster = obj as Grasshopper.Kernel.Special.GH_Cluster;
      if (cluster != null)
      {
        var clusterPath = cluster.FilePath;
        if (!string.IsNullOrEmpty(clusterPath))
        {
          if (cluster.Synchronisation == Grasshopper.Kernel.Special.GH_Synchronisation.OutOfDate)
          {
            cluster.CreateFromFilePath(clusterPath);
            updateLog.Add("Updated: " + clusterPath);
          }
          else if (cluster.Synchronisation == Grasshopper.Kernel.Special.GH_Synchronisation.MissingReference)
          {
            string newPath = ReplacePath(localPath, clusterPath);
            if (!string.IsNullOrEmpty(newPath))
            {
              cluster.CreateFromFilePath(newPath);
              updateLog.Add("Replaced and updated: " + newPath);
            }
            else
            {
              updateLog.Add("Missing reference: " + clusterPath);
            }

          }
        }

        //Update recursively
        if (recursive)
        {
          GH_Document clusterDoc = GetClusterDoc(cluster);
          if (clusterDoc != null)
            UpdateClusters(clusterDoc, recursive, localPath);
        }
      }
    }
  }

  GH_Document GetClusterDoc(Grasshopper.Kernel.Special.GH_Cluster cluster)
  {
    //no pass needed
    var doc = cluster.Document(string.Empty);
    if (doc != null)
      return doc;

    //try passwords
    if (_passwords != null && _passwords.Any())
    {
      foreach (var pass in _passwords)
      {
        doc = cluster.Document(pass);
        if (doc != null)
          return doc;
      }
    }

    return null;
  }

  string ReplacePath(string localPath, string missingPath)
  {
    if (String.IsNullOrEmpty(missingPath) || string.IsNullOrEmpty(localPath))
      return null;
    else
    {
      string lastLocalPart = localPath.Split('\\').Last();
      string[] parts = missingPath.Split('\\');
      if (parts.Contains(lastLocalPart))
      {
        int i = Array.IndexOf(parts, lastLocalPart);
        string clusterPath = String.Join("\\", parts.Skip(i + 1));
        string result = String.Join("\\", localPath, clusterPath);
        return result;
      }
      else
        return null;
    }
  }
  // </Custom additional code> 
}
# ---------- end update_all_clusters ----------
panel = Panel(connect_mcp_tools_to_decall)

team_05_definition_cluster = Team05DefinitionCluster()
c_script = CSharpScript()  # -> out, availablePort
# ---------- c_script: C# ----------
// Grasshopper Script Instance
// This script finds an available port on the local machine.
#region Usings
using System;
using System.Linq;
using System.Collections;
using System.Collections.Generic;
using System.Drawing;
using System.Net;
using System.Net.Sockets;

using Rhino;
using Rhino.Geometry;

using Grasshopper;
using Grasshopper.Kernel;
using Grasshopper.Kernel.Data;
using Grasshopper.Kernel.Types;
#endregion

public class Script_Instance : GH_ScriptInstance
{
    #region Notes
    /* 
      Members:
        RhinoDoc RhinoDocument
        GH_Document GrasshopperDocument
        IGH_Component Component
        int Iteration

      Methods (Virtual & overridable):
        Print(string text)
        Print(string format, params object[] args)
        Reflect(object obj)
        Reflect(object obj, string method_name)
    */
    #endregion

    private void RunScript(object start, object end, ref object availablePort)
    {
        // Use default values if parameters are not provided
        int startPort = (start != null && int.TryParse(start.ToString(), out int s)) ? s : 3001;
        int endPort = (end != null && int.TryParse(end.ToString(), out int e)) ? e : 3100;

        // Find an available port in the specified range
        try
        {
            availablePort = FindAvailablePortInRange(startPort, endPort);
            Print($"Available port found: {availablePort}");
        }
        catch (Exception ex)
        {
            Print($"Error: {ex.Message}");
            availablePort = null;
        }
    }

    /// <summary>
    /// Checks if a local TCP port is available for binding (i.e., not in use).
    /// Returns True if available, False otherwise.
    /// </summary>
    private bool IsPortAvailableForBind(int port)
    {
        try
        {
            // Create a new TCP socket
            using (Socket socket = new Socket(AddressFamily.InterNetwork, SocketType.Stream, ProtocolType.Tcp))
            {
                // Try to bind to the port on all interfaces (0.0.0.0)
                socket.Bind(new IPEndPoint(IPAddress.Any, port));
                // If successful, the socket is closed by the using statement and return True
                return true;
            }
        }
        catch (SocketException)
        {
            // If binding fails, it means the port is already in use
            return false;
        }
    }

    /// <summary>
    /// Finds an available port by letting the OS assign one.
    /// </summary>
    private int FindAvailablePort()
    {
        Socket socket = new Socket(AddressFamily.InterNetwork, SocketType.Stream, ProtocolType.Tcp);
        socket.Bind(new IPEndPoint(IPAddress.Any, 0)); // Bind to an available port assigned by the OS
        int availablePort = ((IPEndPoint)socket.LocalEndPoint).Port; // Get the assigned port number
        socket.Close(); // Close the socket
        return availablePort;
    }

    /// <summary>
    /// Finds the first available port in a given range.
    /// </summary>
    private int FindAvailablePortInRange(int start = 3001, int end = 3100)
    {
        for (int port = start; port <= end; port++)
        {
            if (IsPortAvailableForBind(port))
                return port;
        }
        throw new Exception($"No available ports found in the range {start}-{end}.");
    }
}
# ---------- end c_script ----------
central_mcp_server = MCPServer(Port=c_script.availablePort, Tools=team_05_definition_cluster, ServerName="Swiftlet")  # -> Compute_volume_of_cube, Count_elements_by_type, Compute_area_of_element, Compute_element_cost
get_tool_names = CSharpScript(x=team_05_definition_cluster)  # -> flatten(out)
# ---------- get_tool_names: C# ----------
// Grasshopper Script Instance
#region Usings
using System;
using System.Linq;
using System.Collections;
using System.Collections.Generic;
using System.Drawing;

using Rhino;
using Rhino.Geometry;

using Grasshopper;
using Grasshopper.Kernel;
using Grasshopper.Kernel.Data;
using Grasshopper.Kernel.Types;
#endregion

public class Script_Instance : GH_ScriptInstance
{
    #region Notes
    /* 
      Members:
        RhinoDoc RhinoDocument
        GH_Document GrasshopperDocument
        IGH_Component Component
        int Iteration

      Methods (Virtual & overridable):
        Print(string text)
        Print(string format, params object[] args)
        Reflect(object obj)
        Reflect(object obj, string method_name)
    */
    #endregion

    private void RunScript(object x)
    {
        dynamic dynamicX = x;
        Console.Write(dynamicX.Name);
    }
}
# ---------- end get_tool_names ----------
panel_2 = Panel(c_script.availablePort)
central_decall = Data([central_mcp_server.Compute_volume_of_cube, central_mcp_server.Count_elements_by_type, central_mcp_server.Compute_area_of_element, central_mcp_server.Compute_element_cost])
clean = CleanTree(RemoveNulls=True, RemoveInvalid=True, RemoveEmpty=False, Tree=central_decall)
team_05_result_cluster = Team05ResultCluster(tool_call_request=clean)  # -> tool_names_3, tool_call_success

# ----
# Tool Names from the Results Clusters
# Tool Names from the Definition Clusters
# These Two Clusters should be EXACTLY THE SAME
panel_3 = Panel(get_tool_names)
panel_4 = Panel(team_05_result_cluster.tool_names_3)

rec = DataRecorder(team_05_result_cluster.tool_call_success, DataLimit=-10, RecordData=True)
rec_2 = DataRecorder(clean, DataLimit=-10, RecordData=True)

# ---- group: Request Parameters
decall = DeconstructToolCall(Request=clean)  # -> Request, Tool, Arguments
rjo = ReadJSONObject(JObject=decall.Arguments)  # -> Keys, JTokens
# Debug: Check request input data
panel_5 = Panel("room_name")
tmatch = MatchText(Text=rjo.Keys, Pattern=panel_5, Case=True)
tmatch_2 = MatchText(Text=rjo.Keys, Pattern="layout_json", Case=True)
dispatch = Dispatch(List=rjo.JTokens, DispatchPattern=tmatch)  # -> ListA, ListB
dispatch_2 = Dispatch(List=rjo.JTokens, DispatchPattern=tmatch_2)  # -> ListA, ListB
panel_6 = Panel(dispatch.ListA)
panel_7 = Panel(dispatch_2.ListA)

# ----
response_ok = Panel(rec)
called_tool_name = Panel(rec_2)

# ----
# Debug Tool Names
# This Panel should always be TRUE
tool_names_from_the_results_clusters = Data(panel_4)
tool_names_from_the_definition_clusters = Data(panel_3)
join = TextJoin(Text=flatten(tool_names_from_the_definition_clusters))
join_2 = TextJoin(Text=flatten(tool_names_from_the_results_clusters))
tstat = TreeStatistics(Tree=tool_names_from_the_definition_clusters)  # -> Paths, Length, Count
tstat_2 = TreeStatistics(Tree=tool_names_from_the_results_clusters)  # -> Paths, Length, Count
dpath = DeconstructPath(Branch=tstat.Paths)
dpath_2 = DeconstructPath(Branch=tstat_2.Paths)
equals = Equality(FirstNumber=tstat.Length, SecondNumber=tstat_2.Length)  # -> Equality, Inequality
equals_2 = Equality(FirstNumber=tstat.Count, SecondNumber=tstat_2.Count)  # -> Equality, Inequality
ma = MassAddition(Input=flatten(equals.Equality))  # -> Result, PartialResults
equals_3 = Equality(FirstNumber=dpath, SecondNumber=dpath_2)  # -> Equality, Inequality
lng = ListLength(List=equals.Equality)
ma_2 = MassAddition(Input=flatten(equals_3.Inequality))  # -> Result, PartialResults
equals_4 = Equality(FirstNumber=ma.Result, SecondNumber=lng)  # -> Equality, Inequality
does_quantity_of_tools_match = Panel(equals_2.Equality)
equals_5 = Equality(FirstNumber=ma_2.Result, SecondNumber="0")  # -> Equality, Inequality
does_quantity_of_tools_match_per_team = Panel(equals_4.Equality)
are_all_teams_included = Panel(equals_5.Equality)

tmatch_3 = MatchText(Text=join, Pattern=join_2, Case=True)

do_all_names_match = Panel(tmatch_3)
and = GateAnd(A=equals_5.Equality, B=equals_4.Equality, C=equals_2.Equality, D=tmatch_3)  # -> flatten(Result)
do_trees_match = Panel(and)

# ==== cluster Team05DefinitionCluster

# ----
# COUNT ELEMENTS BY TYPE
panel = Panel("This tool counts how many doors and windows of a curtain type are there in a layout ")
param = DefineToolParameter(Name="door_count", Type="number", Description="how many doors are there", Required=Toggle(True))
param_2 = DefineToolParameter(Name="door_type", Type="string", Description="what type the doors is", Required=Toggle(True))
param_3 = DefineToolParameter(Name="window_count", Type="number", Description="how many windows are there", Required=Toggle(True))
param_4 = DefineToolParameter(Name="window_type", Type="string", Description="what type the window is", Required=Toggle(True))
merge = Merge(Data1=param, Data2=param_2, Data3=param_3, Data4=param_4)
tool = DefineTool(Name="count_elements_by_type", Description=panel, Parameters=merge)

# ----
# COMPUTE VOLUME OF A WALL
panel_2 = Panel("This tool calculates the volume of the walls")  # disabled
panel_3 = Panel("the unit rate of the wall")  # disabled
panel_4 = Panel("the width of the wall")  # disabled
panel_5 = Panel("the type of the wall")  # disabled
panel_6 = Panel("the heigth of the wall")  # disabled
panel_7 = Panel("the length of the wall")  # disabled
panel_8 = Panel("wall_unit_rate")  # disabled
panel_9 = Panel("wall_length")  # disabled
toggle = BooleanToggle(True)  # disabled
toggle_2 = BooleanToggle(True)  # disabled
panel_10 = Panel("wall_width")  # disabled
toggle_3 = BooleanToggle(True)  # disabled
panel_11 = Panel("wall_type")  # disabled
toggle_4 = BooleanToggle(True)  # disabled
panel_12 = Panel("wall_heigth")  # disabled
panel_13 = Panel("number")  # disabled
panel_14 = Panel("number")  # disabled
panel_15 = Panel("string")  # disabled
panel_16 = Panel("number")  # disabled
panel_17 = Panel("number")  # disabled
panel_18 = Panel("compute_volume_of_wall")  # disabled
param_5 = DefineToolParameter(Name=panel_9, Type=panel_13, Description=panel_7, Required=toggle)  # disabled
param_6 = DefineToolParameter(Name=panel_8, Type=panel_14, Description=panel_3, Required=True)  # disabled
param_7 = DefineToolParameter(Name=panel_10, Type=panel_16, Description=panel_4, Required=toggle_3)  # disabled
param_8 = DefineToolParameter(Name=panel_11, Type=panel_15, Description=panel_5, Required=toggle_2)  # disabled
param_9 = DefineToolParameter(Name=panel_12, Type=panel_17, Description=panel_6, Required=toggle_4)  # disabled
merge_2 = Merge(Data1=param_5, Data2=param_7, Data3=param_9, Data4=param_8, Data5=param_6)  # disabled
tool_2 = DefineTool(Name=panel_18, Description=panel_2, Parameters=merge_2)  # disabled

# ----
# COMPUTE AREA OF A ELEMENT
panel_19 = Panel("This tools computes the area of an element")
param_10 = DefineToolParameter(Name="geometry", Type="object", Description="the geomtry of a object", Required=Toggle(True))
tool_3 = DefineTool(Name="compute_area_of_element", Description=panel_19, Parameters=param_10)

# ----
# Team 05 Definition Cluster
# CUBE TEAM
panel_20 = Panel("This tool computes the volume of a cube by giving it a length of a side.  The output unit is the input unit cubed.")
panel_21 = Panel("Full layout schema as a JSON string. Must contain rooms with name, area_m2, and rate_per_m2 fields.")
param_11 = DefineToolParameter(Name="layout_schema", Type="STRING ", Description=panel_21, Required=Toggle(True))
param_12 = DefineToolParameter(Name="length", Type="number", Description="The Radius of a Cube", Required=Toggle(True))
merge_3 = Merge(Data1=param_12)
tool_4 = DefineTool(Name="compute_volume_of_cube", Description=panel_20, Parameters=merge_3)

# ----
# COMPUTE PRICE BASED ON SPACE AREA
panel_22 = Panel("Computes the total cost of a single room element in the layout schema by multiplying its area m2 by thickness m by rate per m3. Supports volumetric elements like slabs. Returns the full updated layout schema as JSON with total_cost written into the matched room element.")
param_13 = DefineToolParameter(
    Name="update elentmet json",
    Type="string",
    Description="Name of any updated element in lauout schema ",
    Required=Toggle(True))

merge_4 = Merge(Data1=param_13, Data2=param_11)

tool_5 = DefineTool(Name="compute_element_cost", Description=panel_22, Parameters=merge_4)

merge_5 = Merge(Data1=tool_4, Data2=tool_2, Data3=tool_3, Data4=tool, Data5=tool_5)
R = ClusterOutput(merge_5)

# ==== cluster Team05ResultCluster

# ----
# Team 05 Result Cluster
# CUBE TEAM
# Edit Tool Names to
# Match Definition Cluster
tool_names = Panel("""compute_volume_of_cube
compute_area_of_element
count_elements_by_type
compute_element_cost""")

# ----
# Sorting Logic, Please Do Not Edit
tool_call_request = ClusterInput()
tool_names_2 = Text(tool_names)
decall = DeconstructToolCall(Request=tool_call_request)  # -> Request, Tool, Arguments
mindex = MemberIndex(Set=tool_names, Member=decall.Tool)  # -> Index, Count
sift = SiftPattern(List=decall.Request, SiftPattern=mindex.Index)  # -> Output0, Output1, Output2, Output3

# ---- group: Cluster Output
tool_names_3 = ClusterOutput(tool_names_2)

# ---- group: Get the request sent from VSC Agent
# COUNT_ELEMENTS_BY_TYPE
decall_2 = DeconstructToolCall(Request=sift.Output2)  # -> Request, Tool, Arguments

# ----
# COMPUTE_VOLUME_OF_CUBE
decall_3 = DeconstructToolCall(Request=sift.Output0)  # -> Request, Tool, Arguments
gjok = GetJSONObjectKey(JObject=decall_3.Arguments, Key="length")
rjv = ReadJSONValue(JValue=gjok)  # -> AsString, AsNumber, AsBool
rectangle = Rectangle(Plane=PlaneXY(0, 0, 0), XSize=rjv.AsNumber, YSize=rjv.AsNumber, Radius=0)  # -> Rectangle, Length
boxrec = BoxRectangle(Rectangle=rectangle.Rectangle, Height=rjv.AsNumber)
volume = Volume(Geometry=boxrec)  # -> Volume, Centroid
panel = Panel(volume.Volume)
cjv = CreateJSONValue(Value=panel)
cjo = CreateJSONObject(Keys="volume", Values=cjv)
respond = MCPToolResponse(Request=decall_3.Request, Content=cjo, IsError=False)

# ----
# COMPUTE AREA OF ELEMENT
decall_4 = DeconstructToolCall(Request=sift.Output1)  # -> Request, Tool, Arguments
gjok_2 = GetJSONObjectKey(JObject=decall_4.Arguments, Key="geometry")
jobject = JObject(gjok_2)
bounding_rectangle = BoundingRectangle(Geometry=jobject, Plane=PlaneXY(0, 0, 0), Axis=0, Slide=0, Union=True)  # -> Bounding, DimensionX, DimensionY
boundary_surfaces = BoundarySurfaces(Edges=bounding_rectangle.Bounding)
area = Area(Geometry=boundary_surfaces)  # -> Area, Centroid
area_of_element = Panel(area.Area)
respond_2 = MCPToolResponse(Request=decall_4.Request, Content=area_of_element, IsError=False)

panel_2 = Panel(sift.Output3)
# compute_ELEMENT cost
decall_5 = DeconstructToolCall(Request=sift.Output3)  # -> Request, Tool, Arguments

# ----
# COMPUTE_VOLUME_OF_WALL
decall_6 = DeconstructToolCall()  # -> Request, Tool, Arguments; disabled
panel_3 = Panel("wall_unit_rate")  # disabled
panel_4 = Panel("wall_type")  # disabled
panel_5 = Panel("wall_length")  # disabled
panel_6 = Panel("wall_width")  # disabled
panel_7 = Panel("wall_heigth")  # disabled
gjok_3 = GetJSONObjectKey(JObject=decall_6.Arguments, Key=panel_4)  # disabled
gjok_4 = GetJSONObjectKey(JObject=decall_6.Arguments, Key=panel_3)  # disabled
gjok_5 = GetJSONObjectKey(JObject=decall_6.Arguments, Key=panel_6)  # disabled
gjok_6 = GetJSONObjectKey(JObject=decall_6.Arguments, Key=panel_7)  # disabled
gjok_7 = GetJSONObjectKey(JObject=decall_6.Arguments, Key=panel_5)  # disabled
rjv_2 = ReadJSONValue(JValue=gjok_3)  # -> AsString, AsNumber, AsBool; disabled
rjv_3 = ReadJSONValue(JValue=gjok_4)  # -> AsString, AsNumber, AsBool; disabled
read_json_value = ReadJSONValue(JValue=gjok_7)  # -> AsString, AsNumber, AsBool; disabled
rjv_4 = ReadJSONValue(JValue=gjok_5)  # -> AsString, AsNumber, AsBool; disabled
rjv_5 = ReadJSONValue(JValue=gjok_6)  # -> AsString, AsNumber, AsBool; disabled
multiplication = Multiplication(A=read_json_value.AsNumber, B=rjv_5.AsNumber, C=rjv_4.AsNumber)  # disabled
multiplication_2 = Multiplication(A=multiplication, B=rjv_3.AsNumber)  # disabled
merge = Merge(Data1=multiplication, Data2=rjv_2.AsString, Data3=multiplication_2)  # disabled
respond_3 = MCPToolResponse(Request=decall_6.Request, Content=merge, IsError=False)  # disabled

gjok_8 = GetJSONObjectKey(JObject=decall_2.Arguments, Key="door_count")
gjok_9 = GetJSONObjectKey(JObject=decall_2.Arguments, Key="door_type")
gjok_10 = GetJSONObjectKey(JObject=decall_2.Arguments, Key="window_count")
gjok_11 = GetJSONObjectKey(JObject=decall_2.Arguments, Key="window_type")
gjok_12 = GetJSONObjectKey(JObject=decall_5.Arguments, Key="layout_schema")
gjok_13 = GetJSONObjectKey(JObject=decall_5.Arguments, Key="update elentmet json")
panel_8 = Panel(gjok_12)
rjv_6 = ReadJSONValue(JValue=gjok_10)  # -> AsString, AsNumber, AsBool
rjv_7 = ReadJSONValue(JValue=gjok_11)  # -> AsString, AsNumber, AsBool
rjv_8 = ReadJSONValue(JValue=gjok_8)  # -> AsString, AsNumber, AsBool
rjv_9 = ReadJSONValue(JValue=gjok_9)  # -> AsString, AsNumber, AsBool
list_length = ListLength(List=rjv_8.AsNumber)
list_length_2 = ListLength(List=rjv_6.AsNumber)
rjv_10 = ReadJSONValue(JValue=gjok_12)  # -> AsString, AsNumber, AsBool
panel_9 = Panel(list_length)
panel_10 = Panel(rjv_9.AsString)
panel_11 = Panel(list_length_2)
panel_12 = Panel(rjv_7.AsString)
panel_13 = Panel(rjv_10.AsString)
srf = Surface(boundary_surfaces)
cjv_2 = CreateJSONValue(Value=panel_9)
cjv_3 = CreateJSONValue(Value=panel_10)
cjv_4 = CreateJSONValue(Value=panel_11)
cjv_5 = CreateJSONValue(Value=panel_12)
cjo_2 = CreateJSONObject(Keys="door_count", Values=cjv_2)
cjo_3 = CreateJSONObject(Keys="door_type", Values=cjv_3)
cjo_4 = CreateJSONObject(Keys="window_count", Values=cjv_4)
cjo_5 = CreateJSONObject(Keys="window_type", Values=cjv_5)
panel_14 = Panel(cjo_2)

rjv_11 = ReadJSONValue(JValue=gjok_13)  # -> AsString, AsNumber, AsBool
py3 = Python3Script(json_in=rjv_11.AsString, updates_in=rjv_10.AsString)  # -> out, json_str; inputs json_in: String, updates_in: String
# ---------- py3: Python ----------
"""Merge element-level updates into a layout schema. Element-agnostic:
any top-level key — rooms, openings, columns, walls, slabs, project, etc. —
can be added, modified, or replaced. Matches list items by id/uid/name.

INPUT:
    json_in    : str   full layout JSON as text
    updates_in : str   partial JSON (same shape as layout) with edits

OUTPUT:
    json_str : str   full updated layout JSON
    report   : str   summary of what changed
"""

import json


ID_KEYS = ("id", "uid", "name")   # checked in order


def find_id_key(item):
    if not isinstance(item, dict):
        return None
    for k in ID_KEYS:
        if k in item:
            return k
    return None


def deep_merge(base, updates, stats):
    # dict + dict -> recurse per key
    if isinstance(base, dict) and isinstance(updates, dict):
        out = dict(base)
        for k, v in updates.items():
            if k in out:
                out[k] = deep_merge(out[k], v, stats)
            else:
                out[k] = v
                stats["added_keys"] += 1
        return out

    # list + list -> id-merge if objects, else replace
    if isinstance(base, list) and isinstance(updates, list):
        has_objs = any(isinstance(x, dict) for x in base + updates)
        if not has_objs:
            stats["replaced"] += 1
            return list(updates)

        merged = list(base)
        index = {}
        for i, item in enumerate(merged):
            k = find_id_key(item)
            if k is not None:
                index[(k, item[k])] = i

        for u in updates:
            k = find_id_key(u)
            if k is not None and (k, u[k]) in index:
                i = index[(k, u[k])]
                merged[i] = deep_merge(merged[i], u, stats)
                stats["modified_items"] += 1
            else:
                merged.append(u)
                stats["added_items"] += 1
        return merged

    # scalar / type mismatch -> replace
    if base != updates:
        stats["replaced"] += 1
    return updates


json_str = ""
report   = ""

if json_in:
    data = json.loads(json_in)

    if updates_in:
        try:
            patch = json.loads(updates_in)
        except Exception as e:
            patch = None
            report = "updates_in parse error: {}".format(e)

        if isinstance(patch, dict):
            stats = {"added_keys": 0, "added_items": 0,
                     "modified_items": 0, "replaced": 0}
            data = deep_merge(data, patch, stats)
            report = ("added_items={added_items}  modified_items={modified_items}"
                      "  added_keys={added_keys}  replaced={replaced}"
                      .format(**stats))
        elif patch is not None:
            report = "updates_in must be a JSON object at top level"
    else:
        report = "no updates supplied; passthrough"

    json_str = json.dumps(data, indent=2)
# ---------- end py3 ----------

adding_colors = Python3Script(json_in=rjv_10.AsString, seed=Slider(0, range=0..10))  # -> out, json_str; inputs json_in: String
# ---------- adding_colors: Python ----------
"""Embed cost-based colors into priced JSON, with seed-driven palette variation.

INPUT:
    json_in : str   priced JSON as text
    seed    : int   palette seed; 0 or empty = default ramps

OUTPUT:
    json_str : modified JSON as string
"""

import json
import random
import colorsys

DEFAULT_RAMPS = {
    "rooms":   [(0.0, "#FFF5DC"), (0.25, "#FED976"), (0.5, "#FEB24C"),
                (0.75, "#F06913"), (1.0, "#BD0026")],
    "doors":   [(0.0, "#E8CDAA"), (0.5, "#B27A41"), (1.0, "#643719")],
    "windows": [(0.0, "#D2E8F0"), (0.5, "#5AA0CD"), (1.0, "#194B91")],
    "columns": [(0.0, "#C8C8C8"), (0.5, "#828282"), (1.0, "#323232")],
}

RAMP_STOPS = {"rooms": 5, "doors": 3, "windows": 3, "columns": 3}


def hex_to_rgb(h):
    h = h.lstrip("#")
    return [int(h[0:2], 16), int(h[2:4], 16), int(h[4:6], 16)]


def rgb_to_hex(rgb):
    return "#{:02X}{:02X}{:02X}".format(int(rgb[0]), int(rgb[1]), int(rgb[2]))


def lerp(a, b, t):
    return a + (b - a) * t


def build_random_ramp(rng, n_stops):
    """Pick a random hue, build a light-to-dark ramp of that hue."""
    hue = rng.random()
    stops = []
    for i in range(n_stops):
        t = i / float(n_stops - 1)
        s = 0.15 + t * 0.75
        v = 0.97 - t * 0.55
        r, g, b = colorsys.hsv_to_rgb(hue, s, v)
        stops.append((round(t, 4), rgb_to_hex([r * 255, g * 255, b * 255])))
    return stops


def sample_ramp(ramp, t):
    t = max(0.0, min(1.0, t))
    for i in range(len(ramp) - 1):
        t0, h0 = ramp[i]
        t1, h1 = ramp[i + 1]
        if t0 <= t <= t1:
            u = (t - t0) / (t1 - t0) if t1 > t0 else 0.0
            r0, g0, b0 = hex_to_rgb(h0)
            r1, g1, b1 = hex_to_rgb(h1)
            return [int(lerp(r0, r1, u)),
                    int(lerp(g0, g1, u)),
                    int(lerp(b0, b1, u))]
    return hex_to_rgb(ramp[-1][1])


def paint(items, cost_key, ramp):
    """Rank-based mapping per category.
    Distinct costs -> distinct t -> distinct colors.
    Ties in cost share a color. Evenly spreads colors across the ramp."""
    if not items:
        return None, None
    costs = [it.get(cost_key, 0) or 0 for it in items]
    cmin, cmax = min(costs), max(costs)

    unique_sorted = sorted(set(costs))
    n_unique = len(unique_sorted)
    rank_map = {c: i for i, c in enumerate(unique_sorted)}

    for it in items:
        c = it.get(cost_key, 0) or 0
        rank = rank_map[c]
        t = rank / float(n_unique - 1) if n_unique > 1 else 0.5
        rgb = sample_ramp(ramp, t)
        it["heat_t"]    = round(t, 4)
        it["cost_rank"] = rank
        it["color_rgb"] = rgb
        it["color_hex"] = rgb_to_hex(rgb)
    return cmin, cmax


json_str = ""

if json_in:
    data = json.loads(json_in)

    if seed:
        rng = random.Random(seed)
        ramps = {k: build_random_ramp(rng, RAMP_STOPS[k]) for k in DEFAULT_RAMPS}
    else:
        ramps = DEFAULT_RAMPS

    openings = data.get("openings", [])
    doors   = [o for o in openings if o.get("type") == "door"]
    windows = [o for o in openings if o.get("type") == "window"]

    r_min, r_max = paint(data.get("rooms", []),   "total_cost", ramps["rooms"])
    d_min, d_max = paint(doors,                   "cost",       ramps["doors"])
    w_min, w_max = paint(windows,                 "cost",       ramps["windows"])
    k_min, k_max = paint(data.get("columns", []), "cost",       ramps["columns"])

    data["heatmap"] = {
        "ranges": {
            "rooms":   {"min": r_min or 0.0, "max": r_max or 0.0},
            "doors":   {"min": d_min or 0.0, "max": d_max or 0.0},
            "windows": {"min": w_min or 0.0, "max": w_max or 0.0},
            "columns": {"min": k_min or 0.0, "max": k_max or 0.0},
        },
        "ramps": {k: [{"t": t, "hex": h} for t, h in v] for k, v in ramps.items()},
        "seed":  seed if seed else None,
        "notes": "Rank-based per category: each distinct cost gets a distinct ramp position; ties share a color. color_hex / color_rgb / heat_t / cost_rank stored on each room, opening and column."
    }

    json_str = json.dumps(data, indent=2)
# ---------- end adding_colors ----------
merge_2 = Merge(Data1=cjo_2, Data2=cjo_3, Data3=cjo_4, Data4=cjo_5)
respond_4 = MCPToolResponse(Request=decall_2.Request, Content=merge_2, IsError=False)
pjs = ParseJSONString(Text=adding_colors.json_str)
panel_15 = Panel(adding_colors.json_str)
panel_16 = Panel(pjs)
respond_5 = MCPToolResponse(Request=decall_5.Request, Content=pjs, IsError=False)
py3_2 = Python3Script(json_str=adding_colors.json_str)  # -> out, room_srf, room_col, room_txt, room_pt, door_srf, door_col, door_txt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; inputs json_str: String
# ---------- py3_2: Python ----------
# -*- coding: utf-8 -*-
"""
JSON building plan -> Grasshopper surfaces, colors, labels, anchors.
Input:   json_str (str)  -- paste JSON content as a Panel
Outputs: room_/door_/win_/col_/leg_  *_srf *_col *_txt *_pt
"""
import json
import Rhino.Geometry as rg
import System.Drawing as sd

TOL = 0.001


def hex_to_color(h):
    if not h:
        return sd.Color.Gray
    h = h.lstrip("#")
    return sd.Color.FromArgb(255, int(h[0:2], 16), int(h[2:4], 16), int(h[4:6], 16))


def poly_to_srf(pts, z=0.0):
    p3 = [rg.Point3d(p[0], p[1], z) for p in pts]
    if p3[0].DistanceTo(p3[-1]) > TOL:
        p3.append(p3[0])
    crv = rg.Polyline(p3).ToNurbsCurve()
    breps = rg.Brep.CreatePlanarBreps(crv, TOL)
    return breps[0] if breps else None


def centroid(pts, z=0.05):
    xs = [p[0] for p in pts]
    ys = [p[1] for p in pts]
    return rg.Point3d(sum(xs) / len(xs), sum(ys) / len(ys), z)


def label(name, area, cost, currency):
    return "{}\nA: {} m2\nCost: {} {}".format(name, area, cost, currency)


# ---------- load ----------
if not json_str:
    raise Exception("Connect JSON text to json_str")

data = json.loads(json_str)
currency = data.get("project", {}).get("currency", "")

room_srf, room_col, room_txt, room_pt = [], [], [], []
door_srf, door_col, door_txt, door_pt = [], [], [], []
win_srf,  win_col,  win_txt,  win_pt  = [], [], [], []
col_srf,  col_col,  col_txt,  col_pt  = [], [], [], []
leg_srf,  leg_col,  leg_txt,  leg_pt  = [], [], [], []


# ---------- rooms ----------
for r in data.get("rooms", []):
    s = poly_to_srf(r["polygon"])
    if not s:
        continue
    room_srf.append(s)
    room_col.append(hex_to_color(r.get("color_hex")))
    room_txt.append(label(r.get("name", ""), r.get("area_m2", 0),
                          r.get("total_cost", 0), currency))
    room_pt.append(centroid(r["polygon"]))


# ---------- openings ----------
for o in data.get("openings", []):
    s = poly_to_srf(o["polygon"])
    if not s:
        continue
    color = hex_to_color(o.get("color_hex"))
    name = "{} ({})".format(o.get("id", ""), o.get("subtype", ""))
    txt = label(name, o.get("area_m2", 0), o.get("cost", 0), currency)
    pt = centroid(o["polygon"], 0.1)

    kind = (o.get("type") or "").lower()
    if kind == "door":
        door_srf.append(s); door_col.append(color)
        door_txt.append(txt); door_pt.append(pt)
    elif kind == "window":
        win_srf.append(s); win_col.append(color)
        win_txt.append(txt); win_pt.append(pt)


# ---------- columns ----------
for c in data.get("columns", []):
    s = poly_to_srf(c["polygon"])
    if not s:
        continue
    col_srf.append(s)
    col_col.append(hex_to_color(c.get("color_hex")))
    col_txt.append(label(c.get("id", ""), c.get("area_m2", 0),
                         c.get("cost", 0), currency))
    col_pt.append(centroid(c["polygon"], 0.1))


# ---------- legend ----------
xs, ys = [], []
for grp in ("rooms", "openings", "columns"):
    for it in data.get(grp, []):
        for p in it["polygon"]:
            xs.append(p[0]); ys.append(p[1])

ox = (max(xs) if xs else 0.0) + 3.0
oy = max(ys) if ys else 0.0
cw, ch, gap = 1.2, 0.7, 1.6

ramps  = data.get("heatmap", {}).get("ramps", {})
ranges = data.get("heatmap", {}).get("ranges", {})

for key, title in [("rooms", "Rooms"), ("doors", "Doors"),
                   ("windows", "Windows"), ("columns", "Columns")]:
    ramp = ramps.get(key, [])
    rng  = ranges.get(key, {})
    if not ramp:
        continue

    leg_txt.append("{}  ({:.0f} - {:.0f} {})".format(
        title, rng.get("min", 0), rng.get("max", 0), currency))
    leg_pt.append(rg.Point3d(ox, oy + 0.15, 0))

    for i, stop in enumerate(ramp):
        x0 = ox + i * cw
        y0 = oy - ch
        cell = poly_to_srf([(x0, y0), (x0 + cw, y0),
                            (x0 + cw, y0 + ch), (x0, y0 + ch)])
        if cell:
            leg_srf.append(cell)
            leg_col.append(hex_to_color(stop.get("hex")))

        t = stop.get("t", 0.0)
        v = rng.get("min", 0) + t * (rng.get("max", 0) - rng.get("min", 0))
        leg_txt.append("{:.0f}".format(v))
        leg_pt.append(rg.Point3d(x0 + cw * 0.5, y0 - 0.25, 0))

    oy -= (ch + gap)
# ---------- end py3_2 ----------
preview = CustomPreview(Geometry=py3_2.room_srf, Material=py3_2.room_col)
preview_2 = CustomPreview(Geometry=py3_2.door_srf, Material=py3_2.door_col)
preview_3 = CustomPreview(Geometry=py3_2.win_srf, Material=py3_2.win_col)
preview_4 = CustomPreview(Geometry=py3_2.col_srf, Material=py3_2.col_col)
preview_5 = CustomPreview(Geometry=py3_2.leg_srf, Material=py3_2.leg_col)
or = GateOr(A=respond, B=respond_3, C=respond_2, D=respond_4, E=respond_5)
Z = UnitZ(Factor=Slider(0.1, range=0..0.1))
tool_call_success = ClusterOutput(or)
extr = Extrude(Base=py3_2.win_srf, Direction=Z)
panel_17 = Panel(py3_2.leg_col)
preview_6 = CustomPreview(Geometry=extr, Material=py3_2.win_col)
panel_18 = Panel(py3_2.room_txt)
Z_2 = UnitZ(Factor=Slider(0.4, range=0..1))
number_slider = Slider(8, range=0..100)
wires = BrepWireframe(Brep=[py3_2.room_srf, py3_2.leg_srf], Density=-1)
move = Move(Geometry=py3_2.room_pt, Motion=Z_2)  # -> Geometry, Transform
text_tag_camera = TextTagCamera(Location=py3_2.leg_pt, Text=py3_2.leg_txt, Size=number_slider, Colour=RGB(0, 0, 0))
previewlw = CustomPreviewLineweights(Geometry=wires, Shader=ColourSwatch(SwatchColor=RGB(0, 0, 0)), Absolute=False)
tag = TextTag(Location=move.Geometry, Text=py3_2.room_txt, Colour=ColourSwatch(SwatchColor=RGB(38, 38, 38)))
text_tag_camera_2 = TextTagCamera(Location=move.Geometry, Text=py3_2.room_txt, Size=number_slider, Colour=RGB(0, 0, 0))
